# Grasshopper definition TestFile - Bar1.gh (Grasshopper 1.0.8)
# plug-ins: Karamba3D, NTNU_Pc2025

panel = Panel("""0
2""")
cross_section_range_selector_karamba3d = CroSecRSelect(MaximumHeight_cm=-1, MaximumWidth_cm=-1, menu=[dropdown(1), dropdown(1), dropdown(1)])
curve = Curve(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)
curve_2 = Curve(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)
curve3 = Curve(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)
unit_z = UnitZ(Factor="-1")
explode = Explode(Curve=curve3, Recursive=True)  # -> flatten(Segments), Vertices
list_item = ListItem(List=explode.Vertices, Index="1", Wrap=True)
list_item_2 = ListItem(List=explode.Vertices, Index=panel, Wrap=True)
cross_section_selector_karamba3d = CroSecSelect(CrossSections=cross_section_range_selector_karamba3d, NameOrListIndexOfCrossSection="IPE180")  # -> CrossSection, Info
scale = Scale(Geometry=explode.Segments, Center=Point(0, 0, 0), Factor="0.01")  # -> Geometry, Transform
scale_2 = Scale(Geometry=list_item, Center=Point(0, 0, 0), Factor="0.01")  # -> Geometry, Transform
scale_3 = Scale(Geometry=list_item_2, Center=Point(0, 0, 0), Factor="0.01")  # -> Geometry, Transform
number_slider = Slider(53, range=0..100)
loads_karamba3d = Loads(ForceVector=unit_z, Local=False, PosInd=scale_2.Geometry, LCase="LC0", mode="Point")
support_karamba3d = Supp(PosInd=scale_3.Geometry, Ct_kN_m=Vector(0, 0, 0), Cr_kNm_rad=Vector(0, 0, 0), menu=[buttons(on, on, on, off, off, off)])
fem_design_truss3d = FEMDesignTruss3D(
    Line=explode.Segments,
    LoadNodes=list_item,
    Load=unit_z,
    SupportsNodes=list_item_2,
    ScaleFactor=Slider(16041, range=0..100000))  # -> FEMDisplacement, MovedNodes, MovedElements, FEMForce, FEMSteelUsage
panel_2 = Panel(fem_design_truss3d.FEMDisplacement)
create_linear_element_karamba3d = LineElem(
    Line=scale.Geometry,
    CrossSection=cross_section_selector_karamba3d.CrossSection,
    LimitDistance_m=0.005,
    BucklingLengthY_m=-1,
    BucklingLengthZ_m=-1,
    BucklingLengthLT_m=-1,
    Bending=Toggle(False),
    ToPolylineMaxAngle=0.25,
    ToPolylineTolerance=0.1,
    ToPolylineMaxEdgeLength=0.25,
    New=True,
    Remove=True,
    mode="LineToBeam")  # -> Element, Points, Info
assemble_model_karamba3d = Assemble(
    Elem=flatten(create_linear_element_karamba3d.Element),
    Support=flatten(support_karamba3d),
    Load=flatten(loads_karamba3d),
    LimitDistance_m=0.005)  # -> Model, Info, Mass_kg, CentreOfGravity, LoadCaseNames
disassemble_model_karamba3d = Disassemble(Model=assemble_model_karamba3d.Model)  # -> Model, Point, Beam, Shell, Support, Load, Line, Mesh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
analyse_karamba3d = Analyse(Model=assemble_model_karamba3d.Model)  # -> AnalysedModel, MaximumDisplacement_cm, ResultingForce_kN, ChangeOfElasticEnergy_kNm
panel_3 = Panel(analyse_karamba3d.MaximumDisplacement_cm)
beam_displacements_karamba3d = BeamDisp(AnalysedModel=analyse_karamba3d.AnalysedModel, Ts=[0, 1])  # -> Model, Translations_m, Rotations_rad, LoadCaseIndex
disassemble_cross_section_karamba3d = Disassemble(CroSec=disassemble_model_karamba3d.CrossSection)  # -> CrossSection, FamilyNameOfCrossSection, TypeNameOfCrossSection, ElemIdentifiers, Colour, Material, LocalEccentricity_cm, Heights_cm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
panel_4 = Panel(beam_displacements_karamba3d.Translations_m)
panel_5 = Panel(disassemble_cross_section_karamba3d.Area_cm²)
