# Grasshopper definition TestFile - Bar2.gh (Grasshopper 1.0.8)
# plug-ins: Karamba3D, NTNU_Pc2025

panel = Panel("""0
1""")
cross_section_range_selector_karamba3d = CroSecRSelect(MaximumHeight_cm=-1, MaximumWidth_cm=-1, menu=[dropdown(1), dropdown(1), dropdown(1)])
curvebigger = Curve([<curve referenced from the Rhino model> x3])
curve = Curve([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])
explode = Explode(Curve=curvebigger, Recursive=True)  # -> flatten(Segments), flatten(Vertices)
list_item = ListItem(List=explode.Vertices, Index=panel, Wrap=True)
list_item_2 = ListItem(List=explode.Vertices, Index="7", Wrap=True)
cross_section_selector_karamba3d = CroSecSelect(CrossSections=cross_section_range_selector_karamba3d, NameOrListIndexOfCrossSection="IPE180")  # -> CrossSection, Info
vector_xyz = VectorXYZ(XComponent=0, YComponent=0, ZComponent=Slider(-1, range=-1..1))  # -> Vector, Length
scale = Scale(Geometry=list_item_2, Center=Point(0, 0, 0), Factor="0.01")  # -> Geometry, Transform
scale_2 = Scale(Geometry=explode.Segments, Center=Point(0, 0, 0), Factor="0.01")  # -> Geometry, Transform
scale_3 = Scale(Geometry=list_item, Center=Point(0, 0, 0), Factor="0.01")  # -> Geometry, Transform
number_slider = Slider(488000, range=0..1000000)
fem_design_truss3d = FEMDesignTruss3D(
    Line=explode.Segments,
    LoadNodes=list_item_2,
    Load=vector_xyz.Vector,
    SupportsNodes=list_item,
    ScaleFactor=Slider(21, range=0..100))  # -> FEMDisplacement, MovedNodes, MovedElements, FEMForce, FEMSteelUsage
loads_karamba3d = Loads(ForceVector=vector_xyz.Vector, Local=False, PosInd=scale.Geometry, LCase="LC0", mode="Point")
panel_2 = Panel(fem_design_truss3d.FEMDisplacement)
create_linear_element_karamba3d = LineElem(
    Line=scale_2.Geometry,
    CrossSection=cross_section_selector_karamba3d.CrossSection,
    LimitDistance_m=0.005,
    BucklingLengthY_m=-1,
    BucklingLengthZ_m=-1,
    BucklingLengthLT_m=-1,
    Bending=Toggle(False),
    ToPolylineMaxAngle=0.25,
    ToPolylineTolerance=0.1,
    ToPolylineMaxEdgeLength=0.25,
    New=True,
    Remove=True,
    mode="LineToBeam")  # -> Element, Points, Info
support_karamba3d = Supp(PosInd=scale_3.Geometry, Ct_kN_m=Vector(0, 0, 0), Cr_kNm_rad=Vector(0, 0, 0), menu=[buttons(on, on, on, off, off, off)])
assemble_model_karamba3d = Assemble(Elem=create_linear_element_karamba3d.Element, Support=support_karamba3d, Load=loads_karamba3d, LimitDistance_m=0.005)  # -> Model, Info, Mass_kg, CentreOfGravity, LoadCaseNames
analyse_karamba3d = Analyse(Model=assemble_model_karamba3d.Model)  # -> AnalysedModel, MaximumDisplacement_cm, ResultingForce_kN, ChangeOfElasticEnergy_kNm
beam_displacements_karamba3d = BeamDisp(AnalysedModel=analyse_karamba3d.AnalysedModel, Ts=[0, 1])  # -> Model, Translations_m, Rotations_rad, LoadCaseIndex
panel_3 = Panel(beam_displacements_karamba3d.Translations_m)
