# Grasshopper definition TestFile - Copy.gh (Grasshopper 1.0.8)
# plug-ins: Karamba3D, NTNU_Pc2025

curve = Curve([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])
curve_2 = Curve([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])
curve_3 = Curve([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])
panel = Panel("""0
2
4
6""")
number_slider = Slider(0, range=0..100)
number_slider_2 = Slider(7, range=0..10)
explode = Explode(Curve=curve_2, Recursive=True)  # -> flatten(Segments), flatten(Vertices)
panel_2 = Panel(explode.Vertices)
cross_section_range_selector_karamba3d = CroSecRSelect(MaximumHeight_cm=-1, MaximumWidth_cm=-1, menu=[dropdown(1), dropdown(1), dropdown(1)])
curve_4 = Curve([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])
curve_5 = Curve([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])
curve_6 = Curve([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])
number_slider_3 = Slider(0, range=0..100)
line = Line(explode.Segments)
panel_3 = Panel("""0
2
4
6""")
number_slider_4 = Slider(7, range=0..10)
vector_xyz = VectorXYZ(XComponent=number_slider_2, YComponent=number_slider_2, ZComponent=number_slider_2)  # -> Vector, Length
list_item = ListItem(List=explode.Vertices, Index=panel, Wrap=True)
point = Point(explode.Vertices)
explode_2 = Explode(Curve=curve_6, Recursive=True)  # -> flatten(Segments), flatten(Vertices)
fem_design3d_beam = FEMDesign3DBEAM(Line=line, LoadNodes=point, Load=vector_xyz.Vector, SupportsNodes=list_item, ScaleFactor=Slider(1, range=0..100))  # -> FEMDisplacement, MovedNodes, MovedElements, FEMForce, FEMSteelUsage
line_2 = Line(explode_2.Segments)
vector_xyz_2 = VectorXYZ(XComponent=number_slider_4, YComponent=number_slider_4, ZComponent=number_slider_4)  # -> Vector, Length
point_2 = Point(explode_2.Vertices)
list_item_2 = ListItem(List=explode_2.Vertices, Index=panel_3, Wrap=True)
cross_section_selector_karamba3d = CroSecSelect(CrossSections=cross_section_range_selector_karamba3d, NameOrListIndexOfCrossSection="IPE 180")  # -> CrossSection, Info
move = Move(Geometry=fem_design3d_beam.MovedNodes, Motion=Vector(0, 0, 10))  # -> Geometry, Transform
scale = Scale(Geometry=line_2, Center=Point(0, 0, 0), Factor="0.01")  # -> Geometry, Transform
scale_2 = Scale(Geometry=point_2, Center=Point(0, 0, 0), Factor="0.01")  # -> Geometry, Transform
optimize_cross_section_karamba3d = OptiCroSec(
    MaximumUtilization=1,
    MaximumDisplacement_cm=-1,
    MaximumVirtualWork_kNcm=0.01,
    NumberOfUtilizationIterations=5,
    NumberOfDisplacementIterations=5,
    NumberOfDisplacementIncrementsPerIteration=2,
    DisplacementTolerance=0.01,
    NumberOfSamplePoints=3,
    ElasticDesign=True,
    GammaM0=1,
    GammaM1=1.1,
    SwayFrame=True)  # -> OptimizedModel, Info, Mass_kg, MaximumDisplacement_cm, ElasticEnergyChange_kNm, MaximumUtilizationViewInsufficientCrossSections, MaximumDisplacementViewLimitCrossSections
text_tag = TextTag(Location=move.Geometry, Text=fem_design3d_beam.FEMDisplacement, Colour=ColourSwatch(SwatchColor=RGB(255, 255, 255)))
line_3 = Line(fem_design3d_beam.MovedElements)
scale_3 = Scale(Geometry=list_item_2, Center=Point(0, 0, 0), Factor="0.01")  # -> Geometry, Transform
create_linear_element_karamba3d = LineElem(
    Line=scale.Geometry,
    CrossSection=cross_section_selector_karamba3d.CrossSection,
    LimitDistance_m=0.005,
    BucklingLengthY_m=-1,
    BucklingLengthZ_m=-1,
    BucklingLengthLT_m=-1,
    Bending=True,
    ToPolylineMaxAngle=0.25,
    ToPolylineTolerance=0.1,
    ToPolylineMaxEdgeLength=0.25,
    New=True,
    Remove=True,
    mode="LineToBeam")  # -> Element, Points, Info
support_karamba3d = Supp(PosInd=scale_3.Geometry, Ct_kN_m=Vector(0, 0, 0), Cr_kNm_rad=Vector(0, 0, 0), menu=[buttons(on, on, on, on, on, on)])
panel_4 = Panel(fem_design3d_beam.FEMSteelUsage)
panel_5 = Panel(fem_design3d_beam.FEMForce)
loads_karamba3d = Loads(ForceVector=vector_xyz_2.Vector, Local=False, PosInd=scale_2.Geometry, LCase="LC0", mode="Point")
assemble_model_karamba3d = Assemble(Elem=create_linear_element_karamba3d.Element, Support=support_karamba3d, Load=loads_karamba3d, LimitDistance_m=0.005)  # -> Model, Info, Mass_kg, CentreOfGravity, LoadCaseNames
panel_6 = Panel(fem_design3d_beam.FEMDisplacement)
license_karamba3d = License()
panel_7 = Panel("3.21")
analyse_karamba3d = Analyse(Model=assemble_model_karamba3d.Model)  # -> AnalysedModel, MaximumDisplacement_cm, ResultingForce_kN, ChangeOfElasticEnergy_kNm
panel_8 = Panel(analyse_karamba3d.MaximumDisplacement_cm)
beam_forces_karamba3d = BForces(AnalysedModel=analyse_karamba3d.AnalysedModel, Ts=[0, 1])  # -> Model, NormalForce_kN, ShearForceVz_kN, ShearForceVy_kN, TorsionalMomentMt_kNm, BendingMomentMy_kNm, BendingMomentMz_kNm, LoadCaseIndex
panel_9 = Panel(beam_forces_karamba3d.NormalForce_kN)
panel_10 = Panel("""0
0.5
1""")
beam_displacements_karamba3d = BeamDisp(AnalysedModel=analyse_karamba3d.AnalysedModel, Ts=panel_10)  # -> Model, Translations_m, Rotations_rad, LoadCaseIndex
panel_11 = Panel(beam_displacements_karamba3d.Translations_m)
disassemble_model_karamba3d = Disassemble(Model=beam_displacements_karamba3d.Model)  # -> Model, Point, Beam, Shell, Support, Load, Line, Mesh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
model_view_karamba3d = ModelView(Model=beam_displacements_karamba3d.Model)  # -> Model, DeformedMesh, DeformedAxes, DeformedModel, MaximumDeformation
disassemble_element_karamba3d = Disassemble(Element=disassemble_model_karamba3d.Beam)  # -> Element, ElementIdentifier, AxisOfElement, CrossSection, Joint, Material, LocalCoordinateSystem, ElementIsActive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
line_4 = Line(graft(disassemble_element_karamba3d.AxisOfElement))
scale_4 = Scale(Geometry=model_view_karamba3d.DeformedAxes, Center=Point(0, 0, 0), Factor="100")  # -> Geometry, Transform
scale_5 = Scale(Geometry=line_4, Center=Point(0, 0, 0), Factor="100")  # -> Geometry, Transform
evaluate_curve = EvaluateCurve(Curve=simplify(scale_5.Geometry), Parameter=panel_10)  # -> Point, Tangent, Angle
disassemble_cross_section_karamba3d = Disassemble(CroSec=disassemble_element_karamba3d.CrossSection)  # -> CrossSection, FamilyNameOfCrossSection, TypeNameOfCrossSection, ElemIdentifiers, Colour, Material, LocalEccentricity_cm, Heights_cm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
text_tag_2 = TextTag(Location=evaluate_curve.Point, Text=beam_displacements_karamba3d.Translations_m)
custom_preview = CustomPreview(Geometry=scale_5.Geometry, Material=ColourSwatch(SwatchColor=RGBA(92, 53, 53, 123)))
number = Number(simplify([disassemble_cross_section_karamba3d.Area_cm², disassemble_cross_section_karamba3d.AreaY_cm², disassemble_cross_section_karamba3d.AreaZ_cm², disassemble_cross_section_karamba3d.Iyy_cm⁴, disassemble_cross_section_karamba3d.Izz_cm⁴, disassemble_cross_section_karamba3d.Ipp_cm⁴, disassemble_cross_section_karamba3d.Cw_cm⁶]))
panel_12 = Panel(number)
