# Grasshopper definition TestFile - Pyramid - Copy.gh (Grasshopper 1.0.8)
# plug-ins: Karamba3D, NTNU_Pc2025

cross_section_range_selector_karamba3d = CroSecRSelect(MaximumHeight_cm=-1, MaximumWidth_cm=-1, menu=[dropdown(1), dropdown(1), dropdown(1)])
brep = Brep(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)
brep_2 = Brep(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)
deconstruct_brep = DeconstructBrep(Brep=brep)  # -> Faces, Edges, Vertices
cross_section_selector_karamba3d = CroSecSelect(CrossSections=cross_section_range_selector_karamba3d, NameOrListIndexOfCrossSection="IPE180")  # -> CrossSection, Info
cross_section_range_selector_karamba3d_2 = CroSecRSelect(MaximumHeight_cm=-1, MaximumWidth_cm=-1, menu=[dropdown(1), dropdown(1), dropdown(1)])
panel = Panel("""2
3
5
7""")
deconstruct_brep_2 = DeconstructBrep(Brep=brep_2)  # -> Faces, Edges, Vertices
scale = Scale(Geometry=deconstruct_brep_2.Edges, Center=Point(0, 0, 0), Factor="0.01")  # -> Geometry, Transform
vector_xyz = VectorXYZ(XComponent=0, YComponent=0, ZComponent=Slider(-1, range=-1..1))  # -> Vector, Length
list_item = ListItem(List=deconstruct_brep_2.Vertices, Index="2", Wrap=True)
scale_2 = Scale(Geometry=list_item, Center=Point(0, 0, 0), Factor="0.01")  # -> Geometry, Transform
cull_index = CullIndex(List=deconstruct_brep_2.Vertices, Indices="2", Wrap=True)
scale_3 = Scale(Geometry=cull_index, Center=Point(0, 0, 0), Factor="0.01")  # -> Geometry, Transform
line = Line(deconstruct_brep_2.Edges)
number_slider = Slider(34, range=0..100)
number_slider_2 = Slider(-1, range=-1..1)
panel_2 = Panel("""0
1
4
6""")
list_item_2 = ListItem(List=deconstruct_brep.Vertices, Index=panel, Wrap=True)
scale_4 = Scale(Geometry=list_item_2, Center=Point(0, 0, 0), Factor="0.01")  # -> Geometry, Transform
scale_5 = Scale(Geometry=deconstruct_brep.Edges, Center=Point(0, 0, 0), Factor="0.01")  # -> Geometry, Transform
fem_design_truss3d = FEMDesignTruss3D(
    Line=line,
    LoadNodes=list_item,
    Load=vector_xyz.Vector,
    SupportsNodes=cull_index,
    ScaleFactor=Slider(268240, range=0..1000000))  # -> FEMDisplacement, MovedNodes, MovedElements, FEMForce, FEMSteelUsage
cross_section_selector_karamba3d_2 = CroSecSelect(CrossSections=cross_section_range_selector_karamba3d_2, NameOrListIndexOfCrossSection="IPE180")  # -> CrossSection, Info
vector_xyz_2 = VectorXYZ(XComponent=number_slider_2, YComponent=number_slider_2, ZComponent=number_slider_2)  # -> Vector, Length
list_item_3 = ListItem(List=deconstruct_brep.Vertices, Index=panel_2, Wrap=True)
scale_6 = Scale(Geometry=list_item_3, Center=Point(0, 0, 0), Factor="0.01")  # -> Geometry, Transform
create_linear_element_karamba3d = LineElem(
    Line=scale.Geometry,
    CrossSection=cross_section_selector_karamba3d.CrossSection,
    LimitDistance_m=0.005,
    BucklingLengthY_m=-1,
    BucklingLengthZ_m=-1,
    BucklingLengthLT_m=-1,
    Bending=Toggle(False),
    ToPolylineMaxAngle=0.25,
    ToPolylineTolerance=0.1,
    ToPolylineMaxEdgeLength=0.25,
    New=True,
    Remove=True,
    mode="LineToBeam")  # -> Element, Points, Info
support_karamba3d = Supp(PosInd=scale_3.Geometry, Ct_kN_m=Vector(0, 0, 0), Cr_kNm_rad=Vector(0, 0, 0), menu=[buttons(on, on, on, off, off, off)])
line_2 = Line(deconstruct_brep.Edges)
loads_karamba3d = Loads(ForceVector=vector_xyz.Vector, Local=False, PosInd=scale_2.Geometry, LCase="LC0", mode="Point")
panel_3 = Panel(fem_design_truss3d.FEMDisplacement)
number_slider_3 = Slider(43, range=0..100)
fem_design_truss3d_2 = FEMDesignTruss3D(
    Line=line_2,
    LoadNodes=list_item_2,
    Load=vector_xyz_2.Vector,
    SupportsNodes=list_item_3,
    ScaleFactor=Slider(18060, range=0..1000000))  # -> FEMDisplacement, MovedNodes, MovedElements, FEMForce, FEMSteelUsage
assemble_model_karamba3d = Assemble(Elem=create_linear_element_karamba3d.Element, Support=support_karamba3d, Load=loads_karamba3d, LimitDistance_m=0.005)  # -> Model, Info, Mass_kg, CentreOfGravity, LoadCaseNames
create_linear_element_karamba3d_2 = LineElem(
    Line=scale_5.Geometry,
    CrossSection=cross_section_selector_karamba3d_2.CrossSection,
    LimitDistance_m=0.005,
    BucklingLengthY_m=-1,
    BucklingLengthZ_m=-1,
    BucklingLengthLT_m=-1,
    Bending=Toggle(False),
    ToPolylineMaxAngle=0.25,
    ToPolylineTolerance=0.1,
    ToPolylineMaxEdgeLength=0.25,
    New=True,
    Remove=True,
    mode="LineToBeam")  # -> Element, Points, Info
support_karamba3d_2 = Supp(PosInd=scale_6.Geometry, Ct_kN_m=Vector(0, 0, 0), Cr_kNm_rad=Vector(0, 0, 0), menu=[buttons(on, on, on, off, off, off)])
loads_karamba3d_2 = Loads(ForceVector=vector_xyz_2.Vector, Local=False, PosInd=scale_4.Geometry, LCase="LC0", mode="Point")
panel_4 = Panel(fem_design_truss3d_2.FEMDisplacement)
analyse_karamba3d = Analyse(Model=assemble_model_karamba3d.Model)  # -> AnalysedModel, MaximumDisplacement_cm, ResultingForce_kN, ChangeOfElasticEnergy_kNm
panel_5 = Panel(analyse_karamba3d.MaximumDisplacement_cm)
assemble_model_karamba3d_2 = Assemble(
    Elem=create_linear_element_karamba3d_2.Element,
    Support=support_karamba3d_2,
    Load=loads_karamba3d_2,
    LimitDistance_m=0.005)  # -> Model, Info, Mass_kg, CentreOfGravity, LoadCaseNames
beam_displacements_karamba3d = BeamDisp(AnalysedModel=analyse_karamba3d.AnalysedModel, Ts=[0, 1])  # -> Model, Translations_m, Rotations_rad, LoadCaseIndex
panel_6 = Panel(beam_displacements_karamba3d.Translations_m)
analyse_karamba3d_2 = Analyse(Model=assemble_model_karamba3d_2.Model)  # -> AnalysedModel, MaximumDisplacement_cm, ResultingForce_kN, ChangeOfElasticEnergy_kNm
panel_7 = Panel(analyse_karamba3d_2.MaximumDisplacement_cm)
beam_displacements_karamba3d_2 = BeamDisp(AnalysedModel=analyse_karamba3d_2.AnalysedModel, Ts=[0, 1])  # -> Model, Translations_m, Rotations_rad, LoadCaseIndex
panel_8 = Panel(beam_displacements_karamba3d_2.Translations_m)
